# Grasshopper definition Greeble.gh (Grasshopper 0.9.76)
# plug-ins: LunchBox, Weaverbird

number_slider = Slider(10, range=0..10)
c_script = CSharpScript(x=Slider(3, range=0..10))  # -> out, A; inputs x: Int32
# ---------- c_script: C# ----------
    var points = new List<Point3d>();

    for( int i = 0; i < x; ++i )
      for( int j = 0; j < x; ++j )
      {

        points.Add(new Point3d(i, j, 0.5 * ( Math.Sin(i) * Math.Cos(j) )));

      }

    A = points;
# ---------- end c_script ----------
number_slider_2 = Slider(4, range=0..10)
number_slider_3 = Slider(0.253, range=0..1)
toggle = BooleanToggle(True)
sph = Sphere(Base=PlaneXY(0, 0, 0), Radius=1)  # disabled
pt = ConstructPoint(XCoordinate=0, YCoordinate=0, ZCoordinate=0)
c_script_2 = CSharpScript(
    points=c_script.A,
    subDivideIter=number_slider_2,
    treshold=number_slider_3,
    sierpinsky=toggle,
    iter=Slider(3, range=0..10),
    Reference=["C:\Program Files\Common Files\McNeel\Rhinoceros\5.0\Plug-ins\Grasshopper (b45a29b1-4343-4035-989e-044e8580d9cf)\0.9.76.0\Components\Surface.gha", "C:\Program Files\Common Files\McNeel\Rhinoceros\5.0\Plug-ins\Grasshopper (b45a29b1-4343-4035-989e-044e8580d9cf)\0.9.76.0\Components\Triangulation.gha"])  # -> A, B, C, D; inputs points: list of Point3d, subDivideIter: Int32, treshold: Double, sierpinsky: Boolean, iter: Int32
# ---------- c_script_2: C# ----------
    var extrusionFaces = new List<Curve>();
    var extrusions = FirstIteration(points, out extrusionFaces);

    var extrusionFacesIteration = new List<Curve>[iter];
    //var extrusionFacesIterationOut = new List<Curve>[iter];
    var extrusionIteration = new List<Extrusion>[iter];

    extrusionIteration[0] = Iterations(extrusions, extrusionFaces, out extrusionFacesIteration[0], subDivideIter, treshold, sierpinsky);
    treshold *= 0.5;
    extrusionIteration[1] = Iterations(extrusionIteration[0], extrusionFacesIteration[0], out extrusionFacesIteration[1], subDivideIter, treshold, sierpinsky);
    treshold *= 0.5;
    extrusionIteration[2] = Iterations(extrusionIteration[1], extrusionFacesIteration[1], out extrusionFacesIteration[2], subDivideIter, treshold, sierpinsky);

    A = extrusions;

    B = extrusionIteration[0];

    C = extrusionIteration[1];

    D = extrusionIteration[2];

    /*
    var extrusionFacesTree = new List<Curve>();
    var extrusionTree = Iterations(extrusions, extrusionFaces, out extrusionFacesTree, subDivideIter, treshold, sierpinsky);

    var extrusionFacesList = new List<Curve>();
    var extrusionsOne = Iterations(extrusionTree, extrusionFacesTree, out extrusionFacesList, subDivideIter, treshold * 0.5, sierpinsky);

    A = extrusions;

    B = extrusionTree;

    C = extrusionsOne;
    */

    /*
    var nestedList = new List<Extrusion>[iter];
    var tree = new DataTree<Extrusion>();
    var facesTree = new DataTree<Curve>();
    //var extrusionWireFrame = new List<Curve>[iter];

    for(int i = 0; i < extrusions.Count; ++i)
    {

    tree.Add(extrusions[i], new GH_Path(0));
    facesTree.Add(extrusionFaces[i], new GH_Path(0));

    }

    for(int i = 0; i < iter; ++i)
    {

    nestedList[i] = (Iterations(extrusions, extrusionFaces, out extrusionFacesTree[i], subDivideIter, treshold, sierpinsky));
    //extrusionWireFrame[i] = ExtrusionFaces(nestedList[i]);
    //nestedList[i] = (Iterations(nestedList[i], extrusionFacesTree[i+1], out extrusionFacesTree[i], subDivideIter, treshold, sierpinsky));

    treshold *= 0.5;

    A = i;

    for(int j = 0; j < nestedList[i].Count; ++j)
    {

    tree.Add(nestedList[i][j], new GH_Path(i + 1));
    facesTree.Add(extrusionFacesTree[i][j], new GH_Path(i + 1));

    }


    }
    */
# ---------- c_script_2: C# additional code ----------
  private List<Extrusion> Iterations(List<Extrusion> extrusions, List<Curve> extrusionFaces, out List<Curve> extrusionFacesTree, int subDivideIter, double treshold, bool sierpinksy)
  {

    // We finished our first iteration, now to set up the loopable part.
    var polyLines = new Polyline[extrusions.Count];
    var polyLinePoints = new List<Point3d>[extrusions.Count];
    var meshArray = new Mesh[extrusions.Count];

    for(int i = 0; i < extrusions.Count; ++i)
    {

      extrusionFaces[i].TryGetPolyline(out polyLines[i]);
      polyLinePoints[i] = (polyLines[i].ToList());
      polyLinePoints[i].RemoveAt(0);
      meshArray[i] = DelaunayPoints(polyLinePoints[i]);

      // Subdivide and Triangulate mesh.
      meshArray[i] = Triangulate(meshArray[i]);
      for(int j = 0; j < subDivideIter; ++j)
      {

        Subdivide(meshArray[i], treshold, sierpinksy);

      }

    }

    var extrusionFacesOne = new List<Curve>[meshArray.Length];
    var extrusionsOne = new List<Extrusion>[meshArray.Length];
    var extrusionTree = new List<Extrusion>();
    extrusionFacesTree = new List<Curve>();

    for(int i = 0; i < meshArray.Length; ++i)
    {

      extrusionsOne[i] = (PointsToExtrusion(meshArray[i], out extrusionFacesOne[i]));

      var path = new GH_Path(i + 1);


      for(int j = 0; j < extrusionsOne[i].Count; ++j)
      {

        extrusionTree.Add(extrusionsOne[i][j]);
        extrusionFacesTree.Add(extrusionFacesOne[i][j]);

      }

    }

    return extrusionTree;

  }

  private List<Extrusion> FirstIteration(List<Point3d> points, out List<Curve> extrusionFaces)
  {

    // Our first iteration.
    var rhinoMesh = DelaunayPoints(points);

    extrusionFaces = new List<Curve>();

    return PointsToExtrusion(rhinoMesh, out extrusionFaces);

  }

  private List<Extrusion> PointsToExtrusion(Mesh rhinoMesh, out List<Curve> extrusionFaces)
  {

    var ghMesh = GHMesh(rhinoMesh);

    var faceMesh = new List<object>();
    Point3d[] rhinoVerMesh = DeconstructMesh(ghMesh, out faceMesh);

    int[] faceA = new int[rhinoMesh.Faces.Count];
    int[] faceB = new int[rhinoMesh.Faces.Count];
    int[] faceC = new int[rhinoMesh.Faces.Count];
    int[] faceD = MeshFaces(rhinoMesh, out faceA, out faceB, out faceC);

    var listA = new List<Point3d>();
    var listB = new List<Point3d>();
    var listC = new List<Point3d>();
    var listD = new List<Point3d>();
    for( int i = 0; i < faceA.Length; ++i )
    {

      listA.Add(ListItem(rhinoVerMesh.ToList(), faceA[i]));
      listB.Add(ListItem(rhinoVerMesh.ToList(), faceB[i]));
      listC.Add(ListItem(rhinoVerMesh.ToList(), faceC[i]));
      listD.Add(ListItem(rhinoVerMesh.ToList(), faceD[i]));

    }

    extrusionFaces = new List<Curve>();

    var extrusions = SurfaceAndExtrude(listA, listB, listC, listD, out extrusionFaces).ToList();

    return extrusions;

  }

  private List<Curve> ExtrusionFaces(List<Extrusion> extrusions)
  {

    var extrusionFaces = new Curve[extrusions.Count];

    for (int i = 0; i < extrusions.Count; ++i)
    {

      extrusionFaces[i] = extrusions[i].GetWireframe()[1];

    }

    return extrusionFaces.ToList();

  }

  private Extrusion[] SurfaceAndExtrude(List<Point3d> listA, List<Point3d> listB, List<Point3d> listC, List<Point3d> listD, out List<Curve> extrusionFacesOut)
  {

    var doc = new Grasshopper.Kernel.GH_Document();
    var surFourPoints = new SurfaceComponents.SurfaceComponents.Component_4PointSurface();
    var surFourParamsA = surFourPoints.Params.Input[0] as Grasshopper.Kernel.GH_PersistentGeometryParam<Grasshopper.Kernel.Types.GH_Point>;
    surFourParamsA.PersistentData.ClearData();
    var surFourParamsB = surFourPoints.Params.Input[1] as Grasshopper.Kernel.GH_PersistentGeometryParam<Grasshopper.Kernel.Types.GH_Point>;
    surFourParamsB.PersistentData.ClearData();
    var surFourParamsC = surFourPoints.Params.Input[2] as Grasshopper.Kernel.GH_PersistentGeometryParam<Grasshopper.Kernel.Types.GH_Point>;
    surFourParamsC.PersistentData.ClearData();
    var surFourParamsD = surFourPoints.Params.Input[3] as Grasshopper.Kernel.GH_PersistentGeometryParam<Grasshopper.Kernel.Types.GH_Point>;
    surFourParamsD.PersistentData.ClearData();
    for(int i = 0; i < listA.Count; ++i)
    {

      surFourParamsA.PersistentData.Append(new GH_Point(listA[i]));
      surFourParamsB.PersistentData.Append(new GH_Point(listB[i]));
      surFourParamsC.PersistentData.Append(new GH_Point(listC[i]));
      surFourParamsD.PersistentData.Append(new GH_Point(listD[i]));

    }

    var surfaceFourPoints = new List<object>();
    var surfaces = new Grasshopper.Kernel.Types.GH_Surface[listA.Count];
    var breps = new Rhino.Geometry.Brep[listA.Count];

    surFourPoints.ExpireSolution(true);
    doc.AddObject(surFourPoints, false);
    surFourPoints.Params.Output[0].CollectData();
    var sur4Pt = new Point3d[surFourPoints.Params.Output[0].VolatileDataCount];
    var curves = new Curve[surFourPoints.Params.Output[0].VolatileDataCount][];
    var joinCurves = new Curve[surFourPoints.Params.Output[0].VolatileDataCount];
    var extrusions = new Extrusion[surFourPoints.Params.Output[0].VolatileDataCount];

    var extrusionFaces = new Curve[extrusions.Length];

    for (int i = 0; i < surFourPoints.Params.Output[0].VolatileDataCount; ++i)
    {

      surfaceFourPoints.Add(surFourPoints.Params.Output[0].VolatileData.get_Branch(0)[i]);
      Grasshopper.Kernel.GH_Convert.ToGHSurface(surfaceFourPoints[i], GH_Conversion.Both, ref surfaces[i]);
      Grasshopper.Kernel.GH_Convert.ToBrep(surfaces[i], ref breps[i], GH_Conversion.Both);
      curves[i] = breps[i].GetWireframe(0);
      joinCurves[i] = Curve.JoinCurves(curves[i])[0];
      extrusions[i] = Extrusion.Create(joinCurves[i], GetRandomNumber(0.0, 0.5, joinCurves.Length)[i], true);
      extrusionFaces[i] = extrusions[i].GetWireframe()[1];

    }

    extrusionFacesOut = extrusionFaces.ToList();
    return extrusions;

  }

  private int[] MeshFaces(Mesh rhinoMesh, out int[] faceA, out int[] faceB, out int[] faceC)
  {

    faceA = new int[rhinoMesh.Faces.Count];
    faceB = new int[rhinoMesh.Faces.Count];
    faceC = new int[rhinoMesh.Faces.Count];
    var faceD = new int[rhinoMesh.Faces.Count];

    for( int i = 0; i < rhinoMesh.Faces.Count; ++i )
    {

      faceA[i] = rhinoMesh.Faces[i].A;
      faceB[i] = rhinoMesh.Faces[i].B;
      faceC[i] = rhinoMesh.Faces[i].C;
      faceD[i] = rhinoMesh.Faces[i].D;

    }

    return faceD;

  }

  private Point3d[] DeconstructMesh(GH_Mesh ghMesh, out List<object> faceMesh)
  {

    faceMesh = new List<object>();
    var verticesMesh = new List<object>();

    var deMesh = new SurfaceComponents.MeshComponents.Component_DeconstructMesh();
    var meshParams = deMesh.Params.Input[0] as Grasshopper.Kernel.GH_PersistentParam<Grasshopper.Kernel.Types.GH_Mesh>;
    meshParams.PersistentData.ClearData();
    meshParams.PersistentData.Append(ghMesh);

    var doc = new Grasshopper.Kernel.GH_Document();
    deMesh.ExpireSolution(true);
    doc.AddObject(deMesh, false);
    deMesh.Params.Output[0].CollectData();
    var rhinoVerMesh = new Point3d[deMesh.Params.Output[0].VolatileDataCount];
    for (int i = 0; i < deMesh.Params.Output[0].VolatileDataCount; ++i)
    {

      verticesMesh.Add(deMesh.Params.Output[0].VolatileData.get_Branch(0)[i]);
      Grasshopper.Kernel.GH_Convert.ToPoint3d(verticesMesh[i], ref rhinoVerMesh[i], GH_Conversion.Both);

    }

    for (int i = 0; i < deMesh.Params.Output[1].VolatileDataCount; ++i)
    {

      faceMesh.Add(deMesh.Params.Output[1].VolatileData.get_Branch(0)[i]);

    }

    return rhinoVerMesh;

  }

  private GH_Mesh GHMesh(Mesh rhinoMesh)
  {

    var ghMesh = new Grasshopper.Kernel.Types.GH_Mesh();

    Grasshopper.Kernel.GH_Convert.ToGHMesh(rhinoMesh, GH_Conversion.Both, ref ghMesh);

    return ghMesh;

  }

  private Mesh DelaunayPoints(List<Point3d> points)
  {

    var delaunayMesh = new TriangulationComponents.Component_Delaunay();

    var delPoints = delaunayMesh.Params.Input[0] as Grasshopper.Kernel.GH_PersistentGeometryParam<Grasshopper.Kernel.Types.GH_Point>;
    delPoints.PersistentData.ClearData();
    for(int i = 0; i < points.Count; ++i)
    {

      delPoints.PersistentData.Append(new GH_Point(points[i]));

    }

    delaunayMesh.ExpireSolution(true);

    var doc = new Grasshopper.Kernel.GH_Document();
    doc.AddObject(delaunayMesh, false);

    delaunayMesh.Params.Output[0].CollectData();

    var delaunay = delaunayMesh.Params.Output[0].VolatileData.get_Branch(0)[0];

    var mesh = new Mesh();

    Grasshopper.Kernel.GH_Convert.ToMesh(delaunay, ref mesh, GH_Conversion.Both);

    return mesh;

  }

  private Mesh DelaunayMesh(List<Point3d> Points)
  {

    var nodeTwoList = new Grasshopper.Kernel.Geometry.Node2List(Points);
    var delaunayFaces = Grasshopper.Kernel.Geometry.Delaunay.Solver.Solve_Faces(nodeTwoList, 1);
    var delMesh = Grasshopper.Kernel.Geometry.Delaunay.Solver.Solve_Mesh(nodeTwoList, 1, ref delaunayFaces);
    delMesh.Weld(Math.PI);

    return delMesh;

  }

  public Mesh Subdivide(Mesh m, double threshold, bool sierpinsky)
  {
    List<MeshFace> newFaces = new List<MeshFace>();

    foreach (MeshFace mf in m.Faces)
    {
      double mfarea = AreaOfTriangle(m, mf);
      if(mfarea > threshold)
      {
        m.Vertices.AddVertices(FaceMidPoints(m, mf));
        newFaces.Add(new MeshFace(mf.A, m.Vertices.Count - 3, m.Vertices.Count - 1));
        newFaces.Add(new MeshFace(m.Vertices.Count - 3, mf.B, m.Vertices.Count - 2));
        newFaces.Add(new MeshFace(m.Vertices.Count - 1, m.Vertices.Count - 2, mf.C));
        if(sierpinsky == false)
          newFaces.Add(new MeshFace(m.Vertices.Count - 3, m.Vertices.Count - 2, m.Vertices.Count - 1));
      }
      else newFaces.Add(mf);
    }

    m.Faces.Clear();
    m.Faces.AddFaces(newFaces);
    newFaces.Clear();
    return m;

  }

  public List<Point3d> FaceMidPoints(Mesh m, MeshFace mf)
  {
    var rtnlist = new List<Point3d>();
    rtnlist.Add(MidPoint(m.Vertices[mf.A], m.Vertices[mf.B]));
    rtnlist.Add(MidPoint(m.Vertices[mf.B], m.Vertices[mf.C]));
    rtnlist.Add(MidPoint(m.Vertices[mf.C], m.Vertices[mf.A]));
    return rtnlist;
  }

  public Point3d MidPoint(Point3d pt1, Point3d pt2)
  {
    return new Point3d(0.5 * (pt1.X + pt2.X), 0.5 * (pt1.Y + pt2.Y), 0.5 * (pt1.Z + pt2.Z));
  }

  public static Mesh Triangulate(Mesh x)
  {
    int facecount = x.Faces.Count;
    for (int i = 0; i < facecount; i++)
    {
      var mf = x.Faces[i];
      if(mf.IsQuad)
      {
        double dist1 = x.Vertices[mf.A].DistanceTo(x.Vertices[mf.C]);
        double dist2 = x.Vertices[mf.B].DistanceTo(x.Vertices[mf.D]);
        if (dist1 > dist2)
        {
          x.Faces.AddFace(mf.A, mf.B, mf.D);
          x.Faces.AddFace(mf.B, mf.C, mf.D);
        }
        else
        {
          x.Faces.AddFace(mf.A, mf.B, mf.C);
          x.Faces.AddFace(mf.A, mf.C, mf.D);
        }
      }
    }

    var newfaces = new List<MeshFace>();
    foreach (var mf in x.Faces)
    {
      if(mf.IsTriangle) newfaces.Add(mf);
    }

    x.Faces.Clear();
    x.Faces.AddFaces(newfaces);
    return x;
  }

  public double AreaOfTriangle(Point3d pt1, Point3d pt2, Point3d pt3)
  {
    double a = pt1.DistanceTo(pt2);
    double b = pt2.DistanceTo(pt3);
    double c = pt3.DistanceTo(pt1);
    double s = (a + b + c) / 2;
    return Math.Sqrt(s * (s - a) * (s - b) * (s - c));
  }

  public double AreaOfTriangle(Mesh m, MeshFace mf)
  {
    return AreaOfTriangle(m.Vertices[mf.A], m.Vertices[mf.B], m.Vertices[mf.C]);
  }

  private Point3d ListItem(List<Point3d> points, int faceIndex)
  {

    if(faceIndex > points.Count) faceIndex = ( faceIndex % points.Count );

    return points[faceIndex];

  }

  public double[] GetRandomNumber(double minimum, double maximum, int count)
  {
    Random random = new Random();

    var rand = new Double[count];

    for( int i = 0; i < count; ++i )
    {

      rand[i] = random.NextDouble() * (maximum - minimum) + minimum;

    }

    return rand;

  }
# ---------- end c_script_2 ----------
number_slider_4 = Slider(5, range=0..10)
series = Series(Start=0, Step=1, Count=10)
mesh = MeshBrep(
    Brep=sph,
    Settings={GridMaxCount=0, GridMinCount=16, JaggedSeams=False, MaxEdgeLength=0, MinEdgeLength=0.0001, MinTolerance=0, Refine=True, RefineAngle=0, RelativeTolerance=0.65, SimplePlanes=True, Tolerance=0})  # disabled
c_script_3 = CSharpScript(
    x=number_slider_4,
    Reference=["C:\Program Files\Common Files\McNeel\Rhinoceros\5.0\Plug-ins\Grasshopper (b45a29b1-4343-4035-989e-044e8580d9cf)\0.9.76.0\Components\Triangulation.gha", "C:\Program Files\Common Files\McNeel\Rhinoceros\5.0\Plug-ins\Grasshopper (b45a29b1-4343-4035-989e-044e8580d9cf)\0.9.76.0\Components\Surface.gha", "C:\Program Files\Common Files\McNeel\Rhinoceros\5.0\Plug-ins\Grasshopper (b45a29b1-4343-4035-989e-044e8580d9cf)\0.9.76.0\Components\Mathematics.gha", "C:\Users\feli2\AppData\Roaming\Grasshopper\Libraries\LunchBox.gha"])  # -> out, A, B, C; inputs x: Int32
# ---------- c_script_3: C# ----------
    var points = new List<Point3d>();

    for( int i = 0; i < x; ++i )
      for( int j = 0; j < x; ++j )
      {

        points.Add(new Point3d(i, j, 0.5 * ( Math.Sin(i) * Math.Cos(j) )));

      }

    var delaunayMesh = new TriangulationComponents.Component_Delaunay();

    var delPoints = delaunayMesh.Params.Input[0] as Grasshopper.Kernel.GH_PersistentGeometryParam<Grasshopper.Kernel.Types.GH_Point>;
    delPoints.PersistentData.ClearData();
    for(int i = 0; i < points.Count; ++i)
    {

      delPoints.PersistentData.Append(new GH_Point(points[i]));

    }

    delaunayMesh.ExpireSolution(true);

    var doc = new Grasshopper.Kernel.GH_Document();
    doc.AddObject(delaunayMesh, false);

    delaunayMesh.Params.Output[0].CollectData();

    var delaunay = delaunayMesh.Params.Output[0].VolatileData.get_Branch(0)[0];

    var ghMesh = new Grasshopper.Kernel.Types.GH_Mesh();

    Grasshopper.Kernel.GH_Convert.ToGHMesh(delaunay, GH_Conversion.Both, ref ghMesh);

    var rhinoMesh = new Mesh();

    Grasshopper.Kernel.GH_Convert.ToMesh(delaunay, ref rhinoMesh, GH_Conversion.Both);

    var faceA = new int[rhinoMesh.Faces.Count];
    var faceB = new int[rhinoMesh.Faces.Count];
    var faceC = new int[rhinoMesh.Faces.Count];
    var faceD = new int[rhinoMesh.Faces.Count];

    for( int i = 0; i < rhinoMesh.Faces.Count; ++i )
    {

      faceA[i] = rhinoMesh.Faces[i].A;
      faceB[i] = rhinoMesh.Faces[i].B;
      faceC[i] = rhinoMesh.Faces[i].C;
      faceD[i] = rhinoMesh.Faces[i].D;

    }

    var faceMesh = new List<object>();
    var verticesMesh = new List<object>();

    var deMesh = new SurfaceComponents.MeshComponents.Component_DeconstructMesh();
    var meshParams = deMesh.Params.Input[0] as Grasshopper.Kernel.GH_PersistentParam<Grasshopper.Kernel.Types.GH_Mesh>;
    meshParams.PersistentData.ClearData();
    meshParams.PersistentData.Append(ghMesh);

    deMesh.ExpireSolution(true);
    doc.AddObject(deMesh, false);
    deMesh.Params.Output[0].CollectData();
    var rhinoVerMesh = new Point3d[deMesh.Params.Output[0].VolatileDataCount];
    for (int i = 0; i < deMesh.Params.Output[0].VolatileDataCount; ++i)
    {

      verticesMesh.Add(deMesh.Params.Output[0].VolatileData.get_Branch(0)[i]);
      Grasshopper.Kernel.GH_Convert.ToPoint3d(verticesMesh[i], ref rhinoVerMesh[i], GH_Conversion.Both);

    }
    for (int i = 0; i < deMesh.Params.Output[1].VolatileDataCount; ++i)
    {

      faceMesh.Add(deMesh.Params.Output[1].VolatileData.get_Branch(0)[i]);

    }

    var deFace = new SurfaceComponents.MeshComponents.Component_DeconstructFace();
    var deFaceParams = deFace.Params.Input[0] as Grasshopper.Kernel.GH_PersistentParam<Grasshopper.Kernel.Types.GH_MeshFace>;
    deFaceParams.PersistentData.ClearData();
    for( int i = 0; i < faceMesh.Count; ++i )
    {

      deFaceParams.PersistentData.Append(faceMesh[i]);

    }

    var listA = new List<Point3d>();
    var listB = new List<Point3d>();
    var listC = new List<Point3d>();
    var listD = new List<Point3d>();
    for( int i = 0; i < faceA.Length; ++i )
    {

      listA.Add(ListItem(rhinoVerMesh.ToList(), faceA[i]));
      listB.Add(ListItem(rhinoVerMesh.ToList(), faceB[i]));
      listC.Add(ListItem(rhinoVerMesh.ToList(), faceC[i]));
      listD.Add(ListItem(rhinoVerMesh.ToList(), faceD[i]));

    }

    var surFourPoints = new SurfaceComponents.SurfaceComponents.Component_4PointSurface();
    var surFourParamsA = surFourPoints.Params.Input[0] as Grasshopper.Kernel.GH_PersistentGeometryParam<Grasshopper.Kernel.Types.GH_Point>;
    surFourParamsA.PersistentData.ClearData();
    var surFourParamsB = surFourPoints.Params.Input[1] as Grasshopper.Kernel.GH_PersistentGeometryParam<Grasshopper.Kernel.Types.GH_Point>;
    surFourParamsB.PersistentData.ClearData();
    var surFourParamsC = surFourPoints.Params.Input[2] as Grasshopper.Kernel.GH_PersistentGeometryParam<Grasshopper.Kernel.Types.GH_Point>;
    surFourParamsC.PersistentData.ClearData();
    var surFourParamsD = surFourPoints.Params.Input[3] as Grasshopper.Kernel.GH_PersistentGeometryParam<Grasshopper.Kernel.Types.GH_Point>;
    surFourParamsD.PersistentData.ClearData();
    for(int i = 0; i < listA.Count; ++i)
    {

      surFourParamsA.PersistentData.Append(new GH_Point(listA[i]));
      surFourParamsB.PersistentData.Append(new GH_Point(listB[i]));
      surFourParamsC.PersistentData.Append(new GH_Point(listC[i]));
      surFourParamsD.PersistentData.Append(new GH_Point(listD[i]));

    }

    var surfaceFourPoints = new List<object>();
    var surfaces = new Grasshopper.Kernel.Types.GH_Surface[listA.Count];
    var breps = new Rhino.Geometry.Brep[listA.Count];

    surFourPoints.ExpireSolution(true);
    doc.AddObject(surFourPoints, false);
    surFourPoints.Params.Output[0].CollectData();
    var sur4Pt = new Point3d[surFourPoints.Params.Output[0].VolatileDataCount];
    var curves = new Curve[surFourPoints.Params.Output[0].VolatileDataCount][];
    var joinCurves = new Curve[surFourPoints.Params.Output[0].VolatileDataCount];
    var extrusions = new Extrusion[surFourPoints.Params.Output[0].VolatileDataCount];

    var extrusionFaces = new Curve[extrusions.Length];

    // SubDivide using LunchBox.
    var subDivide = new LunchBox.GEN_TriSub();
    var subDivideParams = subDivide.Params.Input[0] as Grasshopper.Kernel.GH_PersistentParam<GH_Curve>;
    deFaceParams.PersistentData.ClearData();

    for (int i = 0; i < surFourPoints.Params.Output[0].VolatileDataCount; ++i)
    {

      surfaceFourPoints.Add(surFourPoints.Params.Output[0].VolatileData.get_Branch(0)[i]);
      Grasshopper.Kernel.GH_Convert.ToGHSurface(surfaceFourPoints[i], GH_Conversion.Both, ref surfaces[i]);
      Grasshopper.Kernel.GH_Convert.ToBrep(surfaces[i], ref breps[i], GH_Conversion.Both);
      curves[i] = breps[i].GetWireframe(0);
      joinCurves[i] = Curve.JoinCurves(curves[i])[0];
      extrusions[i] = Extrusion.Create(joinCurves[i], GetRandomNumber(0.0, 0.5, joinCurves.Length)[i], true);
      extrusionFaces[i] = extrusions[i].GetWireframe()[1];
      //deFaceParams.PersistentData.Append(new GH_Curve(extrusionFaces[i]));

    }

    A = extrusions;

    B = extrusionFaces;
# ---------- c_script_3: C# additional code ----------
  private Surface Extrude(Curve curve, Vector3d vector)
  {

    return Surface.CreateExtrusion(curve, vector);

  }

  private Point3d ListItem(List<Point3d> points, int faceIndex)
  {

    if(faceIndex > points.Count) faceIndex = ( faceIndex % points.Count );

    return points[faceIndex];

  }

  public double[] GetRandomNumber(double minimum, double maximum, int count)
  {
    Random random = new Random();

    var rand = new Double[count];

    for( int i = 0; i < count; ++i )
    {

      rand[i] = random.NextDouble() * (maximum - minimum) + minimum;

    }

    return rand;

  }
# ---------- end c_script_3 ----------
c_script_4 = CSharpScript(
    x=number_slider_4,
    Reference=["C:\Program Files\Common Files\McNeel\Rhinoceros\5.0\Plug-ins\Grasshopper (b45a29b1-4343-4035-989e-044e8580d9cf)\0.9.76.0\Components\Triangulation.gha", "C:\Program Files\Common Files\McNeel\Rhinoceros\5.0\Plug-ins\Grasshopper (b45a29b1-4343-4035-989e-044e8580d9cf)\0.9.76.0\Components\Surface.gha", "C:\Program Files\Common Files\McNeel\Rhinoceros\5.0\Plug-ins\Grasshopper (b45a29b1-4343-4035-989e-044e8580d9cf)\0.9.76.0\Components\Mathematics.gha", "C:\Users\feli2\AppData\Roaming\Grasshopper\Libraries\LunchBox.gha"])  # -> out, A, B, C; inputs x: Int32; same code as c_script_3
number_slider_5 = Slider(5, range=0..10)
msphereex = MeshSphereEx(Base=pt, Radius=Slider(10, range=0..10), Count=5)
crv = Curve(c_script_2.B)
series_2 = Series(Start=0, Step=1, Count=10)
c_script_5 = CSharpScript(x=number_slider_4)  # -> out, A; inputs x: Int32; same code as c_script
number_slider_6 = Slider(15, range=0..20)
crv_2 = Curve(c_script_3.B)
panel = Panel(c_script_3.A)
pt_2 = ConstructPoint(XCoordinate=series_2, YCoordinate=0, ZCoordinate=0)
panel_2 = Panel(c_script_3.B)
panel_3 = Panel(c_script_2.A)
disc = Discontinuity(Curve=crv_2, Level=1)  # -> Points, Parameters
del = DelaunayMesh(Points=c_script_5.A, Plane=PlaneXY(0, 0, 0))
wbtriangles = WeaverbirdsSplitTrianglesSubdivision(MeshCurves=del, Level=Slider(10, range=0..10))
c_script_6 = CSharpScript(
    points=mesh,
    subDivideIter=number_slider_2,
    treshold=number_slider_3,
    sierpinsky=toggle,
    Reference=["C:\Program Files\Common Files\McNeel\Rhinoceros\5.0\Plug-ins\Grasshopper (b45a29b1-4343-4035-989e-044e8580d9cf)\0.9.76.0\Components\Surface.gha", "C:\Program Files\Common Files\McNeel\Rhinoceros\5.0\Plug-ins\Grasshopper (b45a29b1-4343-4035-989e-044e8580d9cf)\0.9.76.0\Components\Triangulation.gha"])  # -> out, A, B; inputs points: Mesh, subDivideIter: Int32, treshold: Double, sierpinsky: Boolean; disabled
# ---------- c_script_6: C# ----------
    var extrusionFaces = new List<Curve>();
    var extrusions = FirstIteration(points);

    //var extrusionFacesTree = new DataTree<Curve>();
    //var extrusionTree = Iterations(extrusions, extrusionFaces, out extrusionFacesTree, subDivideIter, treshold, sierpinsky);

    //var extrusionsOne = Iterations(extrusionTree, ext);

    A = extrusions;

    //B = extrusions;
# ---------- c_script_6: C# additional code ----------
  private DataTree<Extrusion> Iterations(List<Extrusion> extrusions, List<Curve> extrusionFaces, out DataTree<Curve> extrusionFacesTree, int subDivideIter, double treshold, bool sierpinksy)
  {

    // We finished our first iteration, now to set up the loopable part.
    var polyLines = new Polyline[extrusions.Count];
    var polyLinePoints = new List<Point3d>[extrusions.Count];
    var meshArray = new Mesh[extrusions.Count];

    for(int i = 0; i < extrusions.Count; ++i)
    {

      extrusionFaces[i].TryGetPolyline(out polyLines[i]);
      polyLinePoints[i] = (polyLines[i].ToList());
      polyLinePoints[i].RemoveAt(0);
      meshArray[i] = DelaunayPoints(polyLinePoints[i]);

      // Subdivide and Triangulate mesh.
      meshArray[i] = Triangulate(meshArray[i]);
      for(int j = 0; j < subDivideIter; ++j)
      {

        Subdivide(meshArray[i], treshold, sierpinksy);

      }

    }

    var extrusionFacesOne = new List<Curve>[meshArray.Length];
    var extrusionsOne = new List<Extrusion>[meshArray.Length];
    var extrusionTree = new DataTree<Extrusion>();
    extrusionFacesTree = new DataTree<Curve>();

    for(int i = 0; i < meshArray.Length; ++i)
    {

      extrusionTree.Add(extrusions[i], new GH_Path(0));
      extrusionFacesTree.Add(extrusionFaces[i], new GH_Path(0));

      extrusionsOne[i] = (PointsToExtrusion(meshArray[i]));

      var path = new GH_Path(i + 1);

      for(int j = 0; j < extrusionsOne[i].Count; ++j)
      {

        extrusionTree.Add(extrusionsOne[i][j], path);
        extrusionFacesTree.Add(extrusionFacesOne[i][j], path);

      }

    }

    return extrusionTree;

  }

  private List<Extrusion> FirstIteration(Mesh rhinoMesh)
  {

    // Our first iteration.

    //extrusionFaces = new List<Curve>();

    return PointsToExtrusion(rhinoMesh);

  }

  private List<Extrusion> PointsToExtrusion(Mesh rhinoMesh)
  {

    var ghMesh = GHMesh(rhinoMesh);

    var faceMesh = new List<object>();
    Point3d[] rhinoVerMesh = DeconstructMesh(ghMesh, out faceMesh);

    int[] faceA = new int[rhinoMesh.Faces.Count];
    int[] faceB = new int[rhinoMesh.Faces.Count];
    int[] faceC = new int[rhinoMesh.Faces.Count];
    int[] faceD = MeshFaces(rhinoMesh, out faceA, out faceB, out faceC);

    var listA = new List<Point3d>();
    var listB = new List<Point3d>();
    var listC = new List<Point3d>();
    var listD = new List<Point3d>();
    for( int i = 0; i < faceA.Length; ++i )
    {

      listA.Add(ListItem(rhinoVerMesh.ToList(), faceA[i]));
      listB.Add(ListItem(rhinoVerMesh.ToList(), faceB[i]));
      listC.Add(ListItem(rhinoVerMesh.ToList(), faceC[i]));
      listD.Add(ListItem(rhinoVerMesh.ToList(), faceD[i]));

    }

    //extrusionFaces = new List<Curve>();

    var extrusions = SurfaceAndExtrude(listA, listB, listC, listD).ToList();

    return extrusions;

  }

  private Extrusion[] SurfaceAndExtrude(List<Point3d> listA, List<Point3d> listB, List<Point3d> listC, List<Point3d> listD)
  {

    var doc = new Grasshopper.Kernel.GH_Document();
    var surFourPoints = new SurfaceComponents.SurfaceComponents.Component_4PointSurface();
    var surFourParamsA = surFourPoints.Params.Input[0] as Grasshopper.Kernel.GH_PersistentGeometryParam<Grasshopper.Kernel.Types.GH_Point>;
    surFourParamsA.PersistentData.ClearData();
    var surFourParamsB = surFourPoints.Params.Input[1] as Grasshopper.Kernel.GH_PersistentGeometryParam<Grasshopper.Kernel.Types.GH_Point>;
    surFourParamsB.PersistentData.ClearData();
    var surFourParamsC = surFourPoints.Params.Input[2] as Grasshopper.Kernel.GH_PersistentGeometryParam<Grasshopper.Kernel.Types.GH_Point>;
    surFourParamsC.PersistentData.ClearData();
    var surFourParamsD = surFourPoints.Params.Input[3] as Grasshopper.Kernel.GH_PersistentGeometryParam<Grasshopper.Kernel.Types.GH_Point>;
    surFourParamsD.PersistentData.ClearData();
    for(int i = 0; i < listA.Count; ++i)
    {

      surFourParamsA.PersistentData.Append(new GH_Point(listA[i]));
      surFourParamsB.PersistentData.Append(new GH_Point(listB[i]));
      surFourParamsC.PersistentData.Append(new GH_Point(listC[i]));
      surFourParamsD.PersistentData.Append(new GH_Point(listD[i]));

    }

    var surfaceFourPoints = new List<object>();
    var surfaces = new Grasshopper.Kernel.Types.GH_Surface[listA.Count];
    var breps = new Rhino.Geometry.Brep[listA.Count];

    surFourPoints.ExpireSolution(true);
    doc.AddObject(surFourPoints, false);
    surFourPoints.Params.Output[0].CollectData();
    var sur4Pt = new Point3d[surFourPoints.Params.Output[0].VolatileDataCount];
    var curves = new Curve[surFourPoints.Params.Output[0].VolatileDataCount][];
    var joinCurves = new Curve[surFourPoints.Params.Output[0].VolatileDataCount];
    var extrusions = new Extrusion[surFourPoints.Params.Output[0].VolatileDataCount];

    //var extrusionFaces = new Curve[extrusions.Length];

    for (int i = 0; i < surFourPoints.Params.Output[0].VolatileDataCount; ++i)
    {

      surfaceFourPoints.Add(surFourPoints.Params.Output[0].VolatileData.get_Branch(0)[i]);
      Grasshopper.Kernel.GH_Convert.ToGHSurface(surfaceFourPoints[i], GH_Conversion.Both, ref surfaces[i]);
      Grasshopper.Kernel.GH_Convert.ToBrep(surfaces[i], ref breps[i], GH_Conversion.Both);
      curves[i] = breps[i].GetWireframe(0);
      joinCurves[i] = Curve.JoinCurves(curves[i])[0];
      extrusions[i] = Extrusion.Create(joinCurves[i], GetRandomNumber(0.0, 0.5, joinCurves.Length)[i], true);
      //extrusionFaces[i] = extrusions[i].GetWireframe()[1];

    }

    //extrusionFacesOut = extrusionFaces.ToList();
    return extrusions;

  }

  private int[] MeshFaces(Mesh rhinoMesh, out int[] faceA, out int[] faceB, out int[] faceC)
  {

    faceA = new int[rhinoMesh.Faces.Count];
    faceB = new int[rhinoMesh.Faces.Count];
    faceC = new int[rhinoMesh.Faces.Count];
    var faceD = new int[rhinoMesh.Faces.Count];

    for( int i = 0; i < rhinoMesh.Faces.Count; ++i )
    {

      faceA[i] = rhinoMesh.Faces[i].A;
      faceB[i] = rhinoMesh.Faces[i].B;
      faceC[i] = rhinoMesh.Faces[i].C;
      faceD[i] = rhinoMesh.Faces[i].D;

    }

    return faceD;

  }

  private Point3d[] DeconstructMesh(GH_Mesh ghMesh, out List<object> faceMesh)
  {

    faceMesh = new List<object>();
    var verticesMesh = new List<object>();

    var deMesh = new SurfaceComponents.MeshComponents.Component_DeconstructMesh();
    var meshParams = deMesh.Params.Input[0] as Grasshopper.Kernel.GH_PersistentParam<Grasshopper.Kernel.Types.GH_Mesh>;
    meshParams.PersistentData.ClearData();
    meshParams.PersistentData.Append(ghMesh);

    var doc = new Grasshopper.Kernel.GH_Document();
    deMesh.ExpireSolution(true);
    doc.AddObject(deMesh, false);
    deMesh.Params.Output[0].CollectData();
    var rhinoVerMesh = new Point3d[deMesh.Params.Output[0].VolatileDataCount];
    for (int i = 0; i < deMesh.Params.Output[0].VolatileDataCount; ++i)
    {

      verticesMesh.Add(deMesh.Params.Output[0].VolatileData.get_Branch(0)[i]);
      Grasshopper.Kernel.GH_Convert.ToPoint3d(verticesMesh[i], ref rhinoVerMesh[i], GH_Conversion.Both);

    }

    for (int i = 0; i < deMesh.Params.Output[1].VolatileDataCount; ++i)
    {

      faceMesh.Add(deMesh.Params.Output[1].VolatileData.get_Branch(0)[i]);

    }

    return rhinoVerMesh;

  }

  private GH_Mesh GHMesh(Mesh rhinoMesh)
  {

    var ghMesh = new Grasshopper.Kernel.Types.GH_Mesh();

    Grasshopper.Kernel.GH_Convert.ToGHMesh(rhinoMesh, GH_Conversion.Both, ref ghMesh);

    return ghMesh;

  }

  private Mesh DelaunayPoints(List<Point3d> points)
  {

    var delaunayMesh = new TriangulationComponents.Component_Delaunay();

    var delPoints = delaunayMesh.Params.Input[0] as Grasshopper.Kernel.GH_PersistentGeometryParam<Grasshopper.Kernel.Types.GH_Point>;
    delPoints.PersistentData.ClearData();
    for(int i = 0; i < points.Count; ++i)
    {

      delPoints.PersistentData.Append(new GH_Point(points[i]));

    }

    delaunayMesh.ExpireSolution(true);

    var doc = new Grasshopper.Kernel.GH_Document();
    doc.AddObject(delaunayMesh, false);

    delaunayMesh.Params.Output[0].CollectData();

    var delaunay = delaunayMesh.Params.Output[0].VolatileData.get_Branch(0)[0];

    var mesh = new Mesh();

    Grasshopper.Kernel.GH_Convert.ToMesh(delaunay, ref mesh, GH_Conversion.Both);

    return mesh;

  }

  private Mesh DelaunayMesh(List<Point3d> Points)
  {

    var nodeTwoList = new Grasshopper.Kernel.Geometry.Node2List(Points);
    var delaunayFaces = Grasshopper.Kernel.Geometry.Delaunay.Solver.Solve_Faces(nodeTwoList, 1);
    var delMesh = Grasshopper.Kernel.Geometry.Delaunay.Solver.Solve_Mesh(nodeTwoList, 1, ref delaunayFaces);
    delMesh.Weld(Math.PI);

    return delMesh;

  }

  public Mesh Subdivide(Mesh m, double threshold, bool sierpinsky)
  {
    List<MeshFace> newFaces = new List<MeshFace>();

    foreach (MeshFace mf in m.Faces)
    {
      double mfarea = AreaOfTriangle(m, mf);
      if(mfarea > threshold)
      {
        m.Vertices.AddVertices(FaceMidPoints(m, mf));
        newFaces.Add(new MeshFace(mf.A, m.Vertices.Count - 3, m.Vertices.Count - 1));
        newFaces.Add(new MeshFace(m.Vertices.Count - 3, mf.B, m.Vertices.Count - 2));
        newFaces.Add(new MeshFace(m.Vertices.Count - 1, m.Vertices.Count - 2, mf.C));
        if(sierpinsky == false)
          newFaces.Add(new MeshFace(m.Vertices.Count - 3, m.Vertices.Count - 2, m.Vertices.Count - 1));
      }
      else newFaces.Add(mf);
    }

    m.Faces.Clear();
    m.Faces.AddFaces(newFaces);
    newFaces.Clear();
    return m;

  }

  public List<Point3d> FaceMidPoints(Mesh m, MeshFace mf)
  {
    var rtnlist = new List<Point3d>();
    rtnlist.Add(MidPoint(m.Vertices[mf.A], m.Vertices[mf.B]));
    rtnlist.Add(MidPoint(m.Vertices[mf.B], m.Vertices[mf.C]));
    rtnlist.Add(MidPoint(m.Vertices[mf.C], m.Vertices[mf.A]));
    return rtnlist;
  }

  public Point3d MidPoint(Point3d pt1, Point3d pt2)
  {
    return new Point3d(0.5 * (pt1.X + pt2.X), 0.5 * (pt1.Y + pt2.Y), 0.5 * (pt1.Z + pt2.Z));
  }

  public static Mesh Triangulate(Mesh x)
  {
    int facecount = x.Faces.Count;
    for (int i = 0; i < facecount; i++)
    {
      var mf = x.Faces[i];
      if(mf.IsQuad)
      {
        double dist1 = x.Vertices[mf.A].DistanceTo(x.Vertices[mf.C]);
        double dist2 = x.Vertices[mf.B].DistanceTo(x.Vertices[mf.D]);
        if (dist1 > dist2)
        {
          x.Faces.AddFace(mf.A, mf.B, mf.D);
          x.Faces.AddFace(mf.B, mf.C, mf.D);
        }
        else
        {
          x.Faces.AddFace(mf.A, mf.B, mf.C);
          x.Faces.AddFace(mf.A, mf.C, mf.D);
        }
      }
    }

    var newfaces = new List<MeshFace>();
    foreach (var mf in x.Faces)
    {
      if(mf.IsTriangle) newfaces.Add(mf);
    }

    x.Faces.Clear();
    x.Faces.AddFaces(newfaces);
    return x;
  }

  public double AreaOfTriangle(Point3d pt1, Point3d pt2, Point3d pt3)
  {
    double a = pt1.DistanceTo(pt2);
    double b = pt2.DistanceTo(pt3);
    double c = pt3.DistanceTo(pt1);
    double s = (a + b + c) / 2;
    return Math.Sqrt(s * (s - a) * (s - b) * (s - c));
  }

  public double AreaOfTriangle(Mesh m, MeshFace mf)
  {
    return AreaOfTriangle(m.Vertices[mf.A], m.Vertices[mf.B], m.Vertices[mf.C]);
  }

  private Point3d ListItem(List<Point3d> points, int faceIndex)
  {

    if(faceIndex > points.Count) faceIndex = ( faceIndex % points.Count );

    return points[faceIndex];

  }

  public double[] GetRandomNumber(double minimum, double maximum, int count)
  {
    Random random = new Random();

    var rand = new Double[count];

    for( int i = 0; i < count; ++i )
    {

      rand[i] = random.NextDouble() * (maximum - minimum) + minimum;

    }

    return rand;

  }
# ---------- end c_script_6 ----------
demesh = DeconstructMesh(Mesh=del)  # -> Vertices, Faces, Colours, Normals
panel_4 = Panel(demesh.Normals)
del_2 = DelaunayMesh(Points=disc.Points, Plane=PlaneXY(0, 0, 0))  # -> flatten(Mesh)
deface = DeconstructFace(Face=demesh.Faces)  # -> CornerA, CornerB, CornerC, CornerD
c_script_7 = CSharpScript(x=demesh.Vertices, y=deface.CornerA)  # -> out, A; inputs x: list of Point3d, y: Int32
# ---------- c_script_7: C# ----------
    A = ListItem(x, y);
# ---------- c_script_7: C# additional code ----------
  private Point3d ListItem(List<Point3d> points, int faceIndex)
  {

    if(faceIndex > points.Count) faceIndex = ( faceIndex % points.Count );
    
    return points[faceIndex];

  }
# ---------- end c_script_7 ----------
item = ListItem(List=demesh.Vertices, Index=deface.CornerA, Wrap=True)
panel_5 = Panel(item)
panel_6 = Panel(c_script_7.A)
item_2 = ListItem(List=demesh.Vertices, Index=deface.CornerA, Wrap=True)
panel_7 = Panel(item_2)
item_3 = ListItem(List=demesh.Vertices, Index=deface.CornerB, Wrap=True)
item_4 = ListItem(List=demesh.Vertices, Index=deface.CornerC, Wrap=True)
item_5 = ListItem(List=demesh.Vertices, Index=deface.CornerD, Wrap=True)
dom = ConstructDomain(DomainStart=Slider(0, range=0..1), DomainEnd=Slider(0.5, range=0..10))
item_6 = ListItem(List=del_2, Index=0, Wrap=True)
facen = FaceNormals(Mesh=del)  # -> Centers, Normals
lng = ListLength(List=demesh.Faces)
srf4pt = _4PointSurface(CornerA=item_2, CornerB=item_3, CornerC=item_4, CornerD=item_5)
c_script_8 = CSharpScript(y=Slider(7, range=0..10), treshold=Slider(0.026, range=0..1))  # -> out, A; inputs x: Mesh, y: Int32, treshold: Double
# ---------- c_script_8: C# ----------
    x = Triangulate(x);

    for (int i = 0; i < y; i++) Subdivide(x, treshold);

    A = x;
# ---------- c_script_8: C# additional code ----------
  public Mesh Subdivide(Mesh m, double threshold)
  {
    List<MeshFace> newFaces = new List<MeshFace>();

    foreach (MeshFace mf in m.Faces)
    {
      double mfarea = AreaOfTriangle(m, mf);
      if(mfarea > threshold)
      {
        m.Vertices.AddVertices(FaceMidPoints(m, mf));
        newFaces.Add(new MeshFace(mf.A, m.Vertices.Count - 3, m.Vertices.Count - 1));
        newFaces.Add(new MeshFace(m.Vertices.Count - 3, mf.B, m.Vertices.Count - 2));
        newFaces.Add(new MeshFace(m.Vertices.Count - 1, m.Vertices.Count - 2, mf.C));
        newFaces.Add(new MeshFace(m.Vertices.Count - 3, m.Vertices.Count - 2, m.Vertices.Count - 1));
      }
      else newFaces.Add(mf);
    }

    m.Faces.Clear();
    m.Faces.AddFaces(newFaces);
    newFaces.Clear();
    return m;

  }

  public List<Point3d> FaceMidPoints(Mesh m, MeshFace mf)
  {
    var rtnlist = new List<Point3d>();
    rtnlist.Add(MidPoint(m.Vertices[mf.A], m.Vertices[mf.B]));
    rtnlist.Add(MidPoint(m.Vertices[mf.B], m.Vertices[mf.C]));
    rtnlist.Add(MidPoint(m.Vertices[mf.C], m.Vertices[mf.A]));
    return rtnlist;
  }

  public Point3d MidPoint(Point3d pt1, Point3d pt2)
  {
    return new Point3d(0.5 * (pt1.X + pt2.X), 0.5 * (pt1.Y + pt2.Y), 0.5 * (pt1.Z + pt2.Z));
  }

  public static Mesh Triangulate(Mesh x)
  {
    int facecount = x.Faces.Count;
    for (int i = 0; i < facecount; i++)
    {
      var mf = x.Faces[i];
      if(mf.IsQuad)
      {
        double dist1 = x.Vertices[mf.A].DistanceTo(x.Vertices[mf.C]);
        double dist2 = x.Vertices[mf.B].DistanceTo(x.Vertices[mf.D]);
        if (dist1 > dist2)
        {
          x.Faces.AddFace(mf.A, mf.B, mf.D);
          x.Faces.AddFace(mf.B, mf.C, mf.D);
        }
        else
        {
          x.Faces.AddFace(mf.A, mf.B, mf.C);
          x.Faces.AddFace(mf.A, mf.C, mf.D);
        }
      }
    }

    var newfaces = new List<MeshFace>();
    foreach (var mf in x.Faces)
    {
      if(mf.IsTriangle) newfaces.Add(mf);
    }

    x.Faces.Clear();
    x.Faces.AddFaces(newfaces);
    return x;
  }

  public double AreaOfTriangle(Point3d pt1, Point3d pt2, Point3d pt3)
  {
    double a = pt1.DistanceTo(pt2);
    double b = pt2.DistanceTo(pt3);
    double c = pt3.DistanceTo(pt1);
    double s = (a + b + c) / 2;
    return Math.Sqrt(s * (s - a) * (s - b) * (s - c));
  }

  public double AreaOfTriangle(Mesh m, MeshFace mf)
  {
    return AreaOfTriangle(m.Vertices[mf.A], m.Vertices[mf.B], m.Vertices[mf.C]);
  }
# ---------- end c_script_8 ----------
random = Random(Range=dom, Number=lng, Seed=2)  # -> simplify(Random)
amp = Amplitude(Vector=facen.Normals, Amplitude=random)
area = Area(Geometry=srf4pt)  # -> Area, Centroid
vdis = VectorDisplay(Anchor=area.Centroid, Vector=amp)
amp_2 = Amplitude(Vector=demesh.Normals, Amplitude=1)
extr = Extrude(Base=srf4pt, Direction=amp)
move = Move(Geometry=area.Centroid, Motion=amp_2)  # -> Geometry, Transform
debrep = DeconstructBrep(Brep=extr)  # -> Faces, Edges, Vertices
item_7 = ListItem(List=debrep.Faces, Index=Slider(4, range=0..10), Wrap=True)  # -> simplify(Item)
wires = BrepWireframe(Brep=item_7, Density=-1)
join = JoinCurves(Curves=wires, Preserve=False)
trisub = SubdivideTriangle(
    TriangularCurve=join,
    Subdivide=Slider(1, range=0..1),
    Boolean1=Toggle(False),
    Boolean2=Toggle(False),
    Boolean3=Toggle(False),
    Boolean4=Toggle(False),
    Wires=Toggle(False))  # -> TriangleCellsA, simplify(TriangleCellsB)
facen_2 = FaceNormals(Mesh=item_7)  # -> Centers, Normals
lng_2 = ListLength(List=flatten(trisub.TriangleCellsB))
panel_9 = Panel(trisub.TriangleCellsB)
dom_2 = ConstructDomain(DomainStart=Slider(0, range=0..1), DomainEnd=Slider(0.5, range=0..10))
area_2 = Area(Geometry=trisub.TriangleCellsB)  # -> Area, Centroid
random_2 = Random(Range=dom_2, Number=lng_2, Seed=2)  # -> flatten(Random)
lng_3 = ListLength(List=trisub.TriangleCellsB)
branch = TreeBranch(Tree=lng_3, Path="{0}", MaintainPaths=True)
partition = PartitionList(List=random_2, Size=branch)
amp_3 = Amplitude(Vector=facen_2.Normals, Amplitude=partition)
vdis_2 = VectorDisplay(Anchor=area_2.Centroid, Vector=amp_3)
dom_3 = ConstructDomain(DomainStart=Slider(0.7, range=-2..1), DomainEnd=Slider(1, range=0..3))
random_3 = Random(Range=dom_3, Number=lng_2, Seed=Slider(12549129, range=0..100000000))  # -> flatten(Random)
partition_2 = PartitionList(List=random_3, Size=branch)
scale = Scale(Geometry=trisub.TriangleCellsB, Center=area_2.Centroid, Factor=partition_2)  # -> Geometry, Transform
extr_2 = Extrude(Base=scale.Geometry, Direction=amp_3)  # -> simplify(Extrusion)
debrep_2 = DeconstructBrep(Brep=extr_2)  # -> Faces, Edges, Vertices
item_8 = ListItem(List=debrep_2.Faces, Index=Slider(4, range=0..10), Wrap=True)  # -> simplify(Item)
wires_2 = BrepWireframe(Brep=item_8, Density=-1)
join_2 = JoinCurves(Curves=wires_2, Preserve=False)
trisub_2 = SubdivideTriangle(
    TriangularCurve=join_2,
    Subdivide=Slider(1, range=0..1),
    Boolean1=Toggle(False),
    Boolean2=Toggle(False),
    Boolean3=Toggle(False),
    Boolean4=Toggle(False),
    Wires=Toggle(False))  # -> TriangleCellsA, simplify(TriangleCellsB)
facen_3 = FaceNormals(Mesh=item_8)  # -> Centers, Normals
lng_4 = ListLength(List=flatten(trisub_2.TriangleCellsB))
panel_10 = Panel(trisub_2.TriangleCellsB)
dom_4 = ConstructDomain(DomainStart=Slider(0, range=0..1), DomainEnd=Slider(0.3, range=0..10))
area_3 = Area(Geometry=trisub_2.TriangleCellsB)  # -> Area, Centroid
random_4 = Random(Range=dom_4, Number=lng_4, Seed=2)  # -> flatten(Random)
lng_5 = ListLength(List=trisub_2.TriangleCellsB)
branch_2 = TreeBranch(Tree=lng_5, Path="{0;0}", MaintainPaths=True)
partition_3 = PartitionList(List=random_4, Size=branch_2)
amp_4 = Amplitude(Vector=facen_3.Normals, Amplitude=partition_3)
vdis_3 = VectorDisplay(Anchor=area_3.Centroid, Vector=amp_4)
dom_5 = ConstructDomain(DomainStart=Slider(0.3, range=-2..1), DomainEnd=Slider(1, range=0..3))
random_5 = Random(Range=dom_5, Number=lng_4, Seed=Slider(12549129, range=0..100000000))  # -> flatten(Random)
partition_4 = PartitionList(List=random_5, Size=branch_2)
scale_2 = Scale(Geometry=trisub_2.TriangleCellsB, Center=area_3.Centroid, Factor=partition_4)  # -> Geometry, Transform
extr_3 = Extrude(Base=scale_2.Geometry, Direction=amp_4)  # -> simplify(Extrusion)
debrep_3 = DeconstructBrep(Brep=extr_3)  # -> Faces, Edges, Vertices
item_9 = ListItem(List=debrep_3.Faces, Index=Slider(4, range=0..10), Wrap=True)  # -> simplify(Item)
wires_3 = BrepWireframe(Brep=item_9, Density=-1)
join_3 = JoinCurves(Curves=wires_3, Preserve=False)
trisub_3 = SubdivideTriangle(
    TriangularCurve=join_3,
    Subdivide=Slider(1, range=0..1),
    Boolean1=Toggle(False),
    Boolean2=Toggle(False),
    Boolean3=Toggle(False),
    Boolean4=Toggle(False),
    Wires=Toggle(False))  # -> TriangleCellsA, simplify(TriangleCellsB)
facen_4 = FaceNormals(Mesh=item_9)  # -> Centers, Normals
lng_6 = ListLength(List=flatten(trisub_3.TriangleCellsB))
panel_11 = Panel(trisub_3.TriangleCellsB)
dom_6 = ConstructDomain(DomainStart=Slider(0, range=0..1), DomainEnd=Slider(0.2, range=0..10))
area_4 = Area(Geometry=trisub_3.TriangleCellsB)  # -> Area, Centroid
random_6 = Random(Range=dom_6, Number=lng_6, Seed=2)  # -> flatten(Random)
lng_7 = ListLength(List=trisub_3.TriangleCellsB)
branch_3 = TreeBranch(Tree=lng_7, Path="{0;0}", MaintainPaths=True)
partition_5 = PartitionList(List=random_6, Size=branch_3)
amp_5 = Amplitude(Vector=facen_4.Normals, Amplitude=partition_5)
vdis_4 = VectorDisplay(Anchor=area_4.Centroid, Vector=amp_5)
dom_7 = ConstructDomain(DomainStart=Slider(0.3, range=-2..1), DomainEnd=Slider(1, range=0..3))
random_7 = Random(Range=dom_7, Number=lng_6, Seed=Slider(12549129, range=0..100000000))  # -> flatten(Random)
partition_6 = PartitionList(List=random_7, Size=branch_3)
scale_3 = Scale(Geometry=trisub_3.TriangleCellsB, Center=area_4.Centroid, Factor=partition_6)  # -> Geometry, Transform
extr_4 = Extrude(Base=scale_3.Geometry, Direction=amp_5)  # -> simplify(Extrusion)
debrep_4 = DeconstructBrep(Brep=extr_4)  # -> Faces, Edges, Vertices
item_10 = ListItem(List=debrep_4.Faces, Index=Slider(4, range=0..10), Wrap=True)  # -> simplify(Item)
wires_4 = BrepWireframe(Brep=item_10, Density=-1)
join_4 = JoinCurves(Curves=wires_4, Preserve=False)
trisub_4 = SubdivideTriangle(
    TriangularCurve=join_4,
    Subdivide=Slider(1, range=0..1),
    Boolean1=Toggle(False),
    Boolean2=Toggle(False),
    Boolean3=Toggle(False),
    Boolean4=Toggle(False),
    Wires=Toggle(False))  # -> TriangleCellsA, simplify(TriangleCellsB)
facen_5 = FaceNormals(Mesh=item_10)  # -> Centers, Normals
lng_8 = ListLength(List=flatten(trisub_4.TriangleCellsB))
panel_12 = Panel(trisub_4.TriangleCellsB)  # disabled
dom_8 = ConstructDomain(DomainStart=Slider(0, range=0..1), DomainEnd=Slider(0.1, range=0..10))
area_5 = Area(Geometry=trisub_4.TriangleCellsB)  # -> Area, Centroid
random_8 = Random(Range=dom_8, Number=lng_8, Seed=2)  # -> flatten(Random)
lng_9 = ListLength(List=trisub_4.TriangleCellsB)
branch_4 = TreeBranch(Tree=lng_9, Path="{0;0}", MaintainPaths=True)
partition_7 = PartitionList(List=random_8, Size=branch_4)
amp_6 = Amplitude(Vector=facen_5.Normals, Amplitude=partition_7)
vdis_5 = VectorDisplay(Anchor=area_5.Centroid, Vector=amp_6)
dom_9 = ConstructDomain(DomainStart=Slider(0.3, range=-2..1), DomainEnd=Slider(1, range=0..3))
random_9 = Random(Range=dom_9, Number=lng_8, Seed=Slider(12549129, range=0..100000000))  # -> flatten(Random)
partition_8 = PartitionList(List=random_9, Size=branch_4)
scale_4 = Scale(Geometry=trisub_4.TriangleCellsB, Center=area_5.Centroid, Factor=partition_8)  # -> Geometry, Transform
extr_5 = Extrude(Base=scale_4.Geometry, Direction=amp_6)  # -> simplify(Extrusion)
merge = Merge(Data1=extr, Data2=extr_2, Data3=extr_3, Data4=extr_4, Data5=extr_5)
debrep_5 = DeconstructBrep(Brep=extr_5)  # -> Faces, Edges, Vertices; disabled
number_slider_7 = Slider(4, range=0..10)  # disabled
scale_5 = Scale(Center=Point(0, 0, 0), Factor=0.5)  # -> Geometry, Transform; disabled
item_11 = ListItem(List=debrep_5.Faces, Index=number_slider_7, Wrap=True)  # -> simplify(Item); disabled
wires_5 = BrepWireframe(Brep=item_11, Density=-1)  # disabled
join_5 = JoinCurves(Curves=wires_5, Preserve=False)  # disabled
number_slider_8 = Slider(1, range=0..1)  # disabled
toggle_2 = BooleanToggle(False)  # disabled
toggle_3 = BooleanToggle(False)  # disabled
toggle_4 = BooleanToggle(False)  # disabled
toggle_5 = BooleanToggle(False)  # disabled
toggle_6 = BooleanToggle(False)  # disabled
trisub_5 = SubdivideTriangle(
    TriangularCurve=join_5,
    Subdivide=number_slider_8,
    Boolean1=toggle_3,
    Boolean2=toggle_2,
    Boolean3=toggle_4,
    Boolean4=toggle_5,
    Wires=toggle_6)  # -> TriangleCellsA, simplify(TriangleCellsB); disabled
number_slider_9 = Slider(0, range=0..1)  # disabled
number_slider_10 = Slider(0.3, range=0..10)  # disabled
facen_6 = FaceNormals(Mesh=item_11)  # -> Centers, Normals; disabled
lng_10 = ListLength(List=flatten(trisub_5.TriangleCellsB))  # disabled
panel_13 = Panel(trisub_5.TriangleCellsB)  # disabled
dom_10 = ConstructDomain(DomainStart=number_slider_9, DomainEnd=number_slider_10)  # disabled
area_6 = Area(Geometry=trisub_5.TriangleCellsB)  # -> Area, Centroid; disabled
random_10 = Random(Range=dom_10, Number=lng_10, Seed=2)  # -> flatten(Random); disabled
lng_11 = ListLength(List=trisub_5.TriangleCellsB)  # disabled
panel_14 = Panel("{0;0}")  # disabled
branch_5 = TreeBranch(Tree=lng_11, Path=panel_14, MaintainPaths=True)  # disabled
partition_9 = PartitionList(List=random_10, Size=branch_5)  # disabled
amp_7 = Amplitude(Vector=facen_6.Normals, Amplitude=partition_9)  # disabled
vdis_6 = VectorDisplay(Anchor=area_6.Centroid, Vector=amp_7)  # disabled
number_slider_11 = Slider(0.3, range=-2..1)  # disabled
number_slider_12 = Slider(1, range=0..3)  # disabled
dom_11 = ConstructDomain(DomainStart=number_slider_11, DomainEnd=number_slider_12)  # disabled
number_slider_13 = Slider(12549129, range=0..100000000)  # disabled
random_11 = Random(Range=dom_11, Number=lng_10, Seed=number_slider_13)  # -> flatten(Random); disabled
partition_10 = PartitionList(List=random_11, Size=branch_5)  # disabled
scale_6 = Scale(Geometry=trisub_5.TriangleCellsB, Center=area_6.Centroid, Factor=partition_10)  # -> Geometry, Transform; disabled
extr_6 = Extrude(Base=scale_6.Geometry, Direction=amp_7)  # -> simplify(Extrusion); disabled
